# Dynamo graph Example CompoundStructure.dyn (Dynamo 1.2.1.3083)

wall_types = WallTypes("Interior - 4 7/8\" Partition (1-hr)")
fromWall = Synthetic.Revit.CompoundStructure.FromWall(wall_types)
watch = Watch(fromWall)
number_from_feet_and_inches = LengthFromString(0.015875)
getLayers = Synthetic.Revit.CompoundStructure.GetLayers(fromWall)
layerToList = Synthetic.Revit.CompoundStructure.LayerToList(getLayers)
code_block = CodeBlock(width=number_from_feet_and_inches, lw=layerToList.out0) { index = 0; width; DSCore.List.ReplaceItemAtIndex(lw,index,width); }
byLayers = Synthetic.Revit.CompoundStructure.ByLayers(code_block.out2, layerToList.out1, layerToList.out2)
watch_2 = Watch(byLayers)
layerByList = Synthetic.Revit.CompoundStructure.LayerByList(code_block.out2, layerToList.out1, layerToList.out2)
current = Synthetic.Revit.Document.Current()
toWall = Synthetic.Revit.CompoundStructure.ToWall(wall_types, byLayers, current)
watch_3 = Watch(toWall)
